# Requirement set f16a (R2026a)
Top-level Aircraft Requirements for the F-16A, derived from the Brandt F-16A reference sizing model (sizing/VnV/BrandtF16A) and cross-referenced against Brandt-F16-A.xls Main tab: only Excel INPUT cells become requirement values. One documented exception, REQ_F16A_025, whose -6 %MAC static-margin floor is design intent rather than a workbook cell and is an Estimate (D-030); its upper bound is now a strict SM < 0, a definition rather than a figure. DRAFT - for RFLP Requirements phase review.

## 1 [REQ_F16A_000] F-16A top-level aircraft requirements (Container)
Root container for top-level requirements derived from the Brandt F-16A sizing analysis (VnV/BrandtF16A) and the Brandt-F16-A.xls Main tab.
Keywords: draft, auto-generated

### 1.1 [REQ_F16A_MISSION] Mission profile requirements (Container)
Keywords: draft, auto-generated

#### 1.1.1 [REQ_F16A_001] Takeoff condition
When executing the Takeoff segment, the aircraft shall operate at sea level (Altitude = 0 ft, Main!K33, input) using 100% afterburner (Main!K36, input). End Mach (0.282, Main!K35) is a computed liftoff speed (=Miss!B5), not a given input.
Rationale: Fixes the ground-roll flight condition used to size takeoff thrust and field length.
Keywords: draft, auto-generated

#### 1.1.2 [REQ_F16A_002] Acceleration condition
While in the Accel segment, the aircraft shall accelerate at an altitude of 10,000 ft (Main!L33, input) to an end Mach number of 0.87 (Main!L35, input) using 0% afterburner / dry power (Main!L36, input). All three values are direct Excel inputs, not formulas.
Rationale: Defines the dry-power acceleration leg from takeoff climb-out to design cruise Mach.
Keywords: draft, auto-generated

#### 1.1.3 [REQ_F16A_003] Climb condition
While in the Climb segment, the aircraft shall climb to an altitude of 40,000 ft (Main!M33, input) using 0% afterburner / dry power (Main!M36, input). End Mach (0.87, Main!M35) is inherited from the Accel segment via formula (=L35), not an independent input.
Rationale: Establishes the target cruise altitude used by all subsequent cruise/dash/combat/egress legs.
Keywords: draft, auto-generated

#### 1.1.4 [REQ_F16A_004] Outbound cruise condition
While in the Cruise segment, the aircraft shall cruise using 0% afterburner / dry power (Main!N36, input). Altitude (40,000 ft) and Mach (0.87) are carried forward from the Climb/Accel segments via formulas (=M33, =M35), not independent inputs at this segment.
Rationale: Specifies dry-power cruise to the combat area.
Keywords: draft, auto-generated

#### 1.1.5 [REQ_F16A_005] Dash condition
While in the Dash segment, the aircraft shall use 50% afterburner (Main!P36, input) to cover a distance of 50 nm (Main!P38, input). Altitude and Mach are carried forward from Cruise via formulas.
Rationale: Defines the partial-afterburner ingress dash leg distance and power setting.
Keywords: draft, auto-generated

#### 1.1.6 [REQ_F16A_006] Combat condition
When entering the Combat segment, the aircraft shall operate at an altitude of 25,000 ft (Main!R33, input) for a duration of 2 min (Main!R39, input), while releasing its expendable payload (Miss!I10, 4400 lb). %AB (Main!R36 = P36 = 50%) is tied to the Dash segment's afterburner setting via formula, not an independent input at this segment.
Rationale: Fixes the combat-persistence duration, altitude, and store-release event.
Keywords: draft, auto-generated

#### 1.1.7 [REQ_F16A_007] Egress condition
While in the Egress segment, the aircraft shall use 0% afterburner / dry power (Main!S36, input) to cover a distance of 50 nm (Main!S38, input) at an altitude of 40,000 ft (Main!S33, input).
Rationale: Defines the dry-power return leg from the combat area.
Keywords: draft, auto-generated

#### 1.1.8 [REQ_F16A_008] Return cruise condition
While in the Cruise2 segment (second cruise leg, toward base), the aircraft shall cruise using 0% afterburner / dry power (Main!V36, input). Altitude and Mach are carried forward via formulas, not independent inputs at this segment. Distance for this leg (Main!V38) is an Excel-computed closure value balancing the overall mission distance budget, not a directly given input.
Rationale: Specifies dry-power cruise on the return leg; unlike Dash/Egress, this leg's range is a computed closure value, not a design input.
Keywords: draft, auto-generated

#### 1.1.9 [REQ_F16A_009] Loiter condition
While in the Loiter segment, the aircraft shall loiter at an altitude of 10,000 ft (Main!W33, input) and Mach 0.30 (Main!W35, input) using 0% afterburner (Main!W36, input) for a duration of 20 min (Main!W39, input).
Rationale: Provides the pre-landing holding/approach-delay reserve.
Keywords: draft, auto-generated

#### 1.1.10 [REQ_F16A_010] Landing condition
While in the Landing segment, the aircraft shall land at sea level (Altitude = 0 ft, Main!X33, input). Landing ground-roll distance (Main!X36 = 2884.95 ft) is an Excel-computed value (=Miss!O6), not a given input; the available landing field length is instead stated as a design input in the Point Performance container (S_land = 4000 ft).
Rationale: Fixes the sea-level landing condition; actual ground-roll performance is verified against the landing field-length requirement.
Keywords: draft, auto-generated

### 1.2 [REQ_F16A_PERF] Point performance requirements (Container)
Keywords: draft, auto-generated

#### 1.2.1 [REQ_F16A_011] Max-Mach point performance
At a weight fraction W/W_TO of 0.8997 (Main!S3, computed elsewhere from fuel-state cells), an altitude of 36,000 ft (Main!T3, input), and a load factor n of 1 (Main!V3, input) with 100% afterburner (Main!W3, input), the aircraft shall be capable of sustained level flight (Ps = 0, Main!X3, input) at Mach 1.6 (Main!U3, input).
Rationale: Defines the top-speed design point on the T/W-vs-W/S constraint diagram (Consts row 23).
Keywords: draft, auto-generated

#### 1.2.2 [REQ_F16A_012] Cruise point performance
At a weight fraction W/W_TO of 0.8997 (Main!S4), an altitude of 36,000 ft (Main!T4, input), and a load factor n of 1 (Main!V4, input) with 0% afterburner (Main!W4, input), the aircraft shall be capable of sustained level flight (Ps = 0, Main!X4, input) at Mach 0.87 (Main!U4, input).
Rationale: Defines the dry-power cruise design point on the constraint diagram (Consts row 24).
Keywords: draft, auto-generated

#### 1.2.3 [REQ_F16A_013] Max-altitude point performance
At a weight fraction W/W_TO of 0.8997 (Main!S5), a load factor n of 1 (Main!V5, input) with 100% afterburner (Main!W5, input), the aircraft shall be capable of sustained level flight (Ps = 0, Main!X5, input) at an altitude of 50,000 ft (Main!T5, input) and Mach 0.87 (Main!U5, input).
Rationale: Defines the service-ceiling design point on the constraint diagram (Consts row 25).
Keywords: draft, auto-generated

#### 1.2.4 [REQ_F16A_014] Subsonic combat-turn point performance
At a weight fraction W/W_TO of 0.8997 (Main!S6), an altitude of 20,000 ft (Main!T6, input), and Mach 0.87 (Main!U6, input) with 100% afterburner (Main!W6, tied to the Max-Altitude condition's setting via formula =W5), the aircraft shall sustain a load factor n of at least 4.5 (Main!V6, input) at Ps = 0 (Main!X6, input).
Rationale: Defines subsonic sustained-turn maneuverability (Consts row 26).
Keywords: draft, auto-generated

#### 1.2.5 [REQ_F16A_015] Supersonic combat-turn point performance
At a weight fraction W/W_TO of 0.8997 (Main!S7), an altitude of 36,000 ft (Main!T7, input), and Mach 1.4 (Main!U7, input) with 100% afterburner (Main!W7, tied to the subsonic combat-turn condition's setting via formula =W6), the aircraft shall sustain a load factor n of at least 1.4 (Main!V7, input) at Ps = 0 (Main!X7, input).
Rationale: Defines supersonic sustained-turn maneuverability (Consts row 27).
Keywords: draft, auto-generated

#### 1.2.6 [REQ_F16A_016] Specific-excess-power point performance
At a weight fraction W/W_TO of 0.8997 (Main!S8), an altitude of 10,000 ft (Main!T8, input), and Mach 0.87 (Main!U8, input) with 100% afterburner (Main!W8, tied via formula =W5) and load factor n = 1 (Main!V8, tied via formula =V5), the aircraft shall achieve a specific excess power of at least 500 ft/s (Main!X8, input). Rows 9-10 (Main!R9:X10) duplicate this same condition via formulas and are not independent requirements.
Rationale: Defines minimum energy-maneuverability at a representative combat condition (Consts row 28; rows 29-30 are a documented copy/paste duplicate).
Keywords: draft, auto-generated

#### 1.2.7 [REQ_F16A_017] Takeoff field-length point performance
At sea level (Main!T12 = 0 ft, input) and full takeoff weight (W/W_TO = 1, Main!S12, input), using a liftoff-speed factor V/V_stall of 1.2 (Main!U12, input), a rolling-friction coefficient mu of 0.03 (Main!V12, input), and 100% afterburner (Main!W12, input), the aircraft shall achieve takeoff within a ground-roll distance of 4,000 ft (Main!X12, input).
Rationale: Defines the available takeoff field length and takeoff power/speed assumptions (Consts row 32).
Keywords: draft, auto-generated

#### 1.2.8 [REQ_F16A_018] Landing field-length point performance
At sea level (Main!T13 = 0 ft, input) and full landing weight (W/W_TO = 1, Main!S13, input), using an approach-speed factor V/V_stall of 1.3 (Main!U13, input), a braking-friction coefficient mu of 0.5 (Main!V13, input), and 0% afterburner (Main!W13, input), the aircraft shall land within a ground-roll distance of 4,000 ft (Main!X13, input).
Rationale: Defines the available landing field length and landing power/speed assumptions (Consts row 33).
Keywords: draft, auto-generated

### 1.3 [REQ_F16A_STRUCT] Structural requirements (Container)
Keywords: draft, auto-generated

#### 1.3.1 [REQ_F16A_019] Ultimate structural load factor
The aircraft primary structure shall withstand an ultimate design load factor n_ult of 9 g (Main!Q27, input) without structural failure.
Rationale: Sets the structural design envelope used to size wing, fuselage, and empennage structural weights (Wt tab).
Keywords: draft, auto-generated

### 1.4 [REQ_F16A_WEIGHT] Weight and payload requirements (Container)
Keywords: draft, auto-generated

#### 1.4.1 [REQ_F16A_020] Permanent payload capacity
The aircraft shall carry a permanent (non-expended) payload of 700 lb (Main!O16, input).
Rationale: Defines the fixed mission payload (e.g. gun, fixed avionics/equipment) that is retained for the full mission and drives OEW.
Keywords: draft, auto-generated

#### 1.4.2 [REQ_F16A_021] Expendable payload capacity
The aircraft shall carry an expendable payload (stores) of 4,400 lb (Main!O17, input), which shall be released during the Combat mission segment (see REQ_F16A_006; Miss!I10 drop event).
Rationale: Defines the mission store/weapons capacity and ties its release to the combat-segment event that drives post-combat weight fraction and egress performance.
Keywords: draft, auto-generated

### 1.5 [REQ_F16A_MATERIALS] Materials requirements (Container)
Keywords: draft, auto-generated

#### 1.5.1 [REQ_F16A_022] Composite material fraction limit
The airframe structural material mix shall use composite materials (carbon fiber + fiberglass) for no more than 20% of structural weight fraction: carbon fiber = 20% (Cost!B42, input), fiberglass = 0% (Cost!B43, input). The remainder shall be Aluminum 65% (Cost!B41, input), Steel 5% (Cost!B44, input), and Titanium 10% (Cost!B45, input); all five fractions are direct Excel inputs summing to 100% (Cost!B46, formula check).
Rationale: Bounds material technology assumptions used in the DAPCA IV cost model's material factor D47 (Cost tab) and reflects a legacy-metallic airframe design philosophy.
Keywords: draft, auto-generated

### 1.6 [REQ_F16A_BALANCE] Balance requirements (Container)
Keywords: draft, auto-generated

#### 1.6.1 [REQ_F16A_023] Tipback angle (TODO)
TODO: the aircraft shall provide a main-gear tipback angle of at least TBD deg across the operational CG range. The criterion is deliberately blank -- a standing student exercise (D-046). For reference only: the Brandt F-16A model computes about 21.5 deg (BrandtBalanceStabControl), an analysis output of the reference aircraft, not a design requirement value.
Rationale: Ensures adequate ground clearance/rotation margin during takeoff rotation without a tail strike.
Keywords: draft, auto-generated, todo

#### 1.6.2 [REQ_F16A_024] Rollover angle (TODO)
TODO: the aircraft shall provide a rollover angle of at least TBD deg across the operational CG and gear track range. The criterion is deliberately blank -- a standing student exercise (D-046), which includes establishing which convention the angle is stated in. For reference only: the Brandt F-16A model computes about 74.4 deg (BrandtBalanceStabControl), an analysis output of the reference aircraft, not a design requirement value.
Rationale: Bounds lateral ground stability (resistance to tip-over in crosswind taxi/turning operations).
Keywords: draft, auto-generated, todo

### 1.7 [REQ_F16A_SC] Stability and control requirements (Container)
Keywords: draft, auto-generated

#### 1.7.1 [REQ_F16A_025] Static margin (relaxed static stability)
The aircraft shall exhibit RELAXED STATIC STABILITY: the static margin SM = (x_np - x_cg)/MAC shall satisfy -6 %MAC <= SM < 0 (CG aft of the neutral point) across the operational CG range, takeoff through landing -- both ends, not an average. The upper bound is STRICT and is a definition, not a figure: relaxed static stability IS negative static margin. The -6 %MAC floor caps how unstable it may be. That figure is an illustrative teaching value, not sourced data (D-030) -- the one invented number left now that D-046's upper bound is gone. Burning fuel and releasing stores moves the CG FORWARD (x_cg 26.1979 -> 26.1451 ft), so landing is the forward, most stable end, where this bites. F16AStaticMarginVerificationTest checks both; the reference model does NOT meet it: BrandtBalanceStabControl computes SM_TO = -0.26 %MAC (meets) but SM_land = +0.21 %MAC (VIOLATES), its neutral point being a simplified approximation (readme_bsc.md).
Rationale: A negative static margin is what relaxed static stability IS: the CG sits aft of the neutral point, cutting trim drag and buying instantaneous turn rate, flyable only because the flight control system supplies artificial stability -- the premise REQ_F16A_L02's fly-by-wire decision rests on. The -6 %MAC floor caps that instability at what the system is assumed able to stabilize; without it, negative alone would admit an aeroplane nothing could fly. Requiring both ends of the CG range, not an average, keeps that true for the whole mission, not only while heavy. It also sizes the stabilator and bounds permissible CG travel.
Keywords: draft, auto-generated

### 1.8 [REQ_F16A_COST] Cost measure of merit (Container)
Keywords: draft, auto-generated

#### 1.8.1 [REQ_F16A_026] Unit flyaway cost (minimize)
Unit flyaway cost shall be MINIMIZED. This is a Measure of Merit (design objective), not a pass/fail threshold: lower is always preferred, and cost is traded against weight, materials and production quantity. For reference only, the Brandt F-16A DAPCA IV model computes about $68.4M (program-year dollars) for the reference aircraft -- context, not an acceptance limit.
Rationale: Cost is an objective to minimize, driving material, weight and production-quantity decisions. It is a Measure of Merit rather than a 'shall not exceed' limit because that is how affordability is traded in conceptual design, and it is homed at the Physical layer (D-043).
Keywords: draft, auto-generated, moe, objective, minimize