# Requirement set f16a_functional_derived (R2026a)
Derived functional/capability requirements for the F-16A, identified during Functional-layer (RFLP F) analysis. PLACEHOLDER values - quantitative acceptance criteria to be defined. Kept separate from the sizing-derived set (f16a.slreqx) to preserve original provenance.

## 1 [REQ_F16A_DERIVED] F-16A derived functional requirements (placeholders) (Container)
Root container for functional requirements derived during RFLP Functional-layer analysis. Each captures an aircraft function required to complete the mission that is not covered by the sizing-derived requirement set. Values are PLACEHOLDER (TBD).
Keywords: draft, derived, placeholder

### 1.1 [REQ_F16A_D01] Maneuvering capability
The aircraft shall provide maneuvering capability (attitude and flight-path control) sufficient to fly the mission profile and combat maneuvers. PLACEHOLDER: quantitative criteria TBD (e.g. roll rate, sustained/instantaneous turn rate, control authority across the flight envelope).
Rationale: Derived from functional analysis: the Maneuver function is required to execute the mission profile and F2T2EA engagement but is not covered by the sizing-derived requirement set.
Keywords: draft, derived, placeholder, todo

### 1.2 [REQ_F16A_D02] Fuel management
The aircraft shall manage onboard fuel (storage, sequencing, feed, and transfer) to complete the mission profile with the required reserves. PLACEHOLDER: quantitative criteria TBD (usable fuel, feed sequencing, CG-neutral transfer).
Rationale: Derived from functional analysis: the ManageFuel function is required to complete the mission profile but is not covered by the sizing-derived requirement set.
Keywords: draft, derived, placeholder, todo

### 1.3 [REQ_F16A_D03] Navigation
The aircraft shall determine its position and follow the planned mission route. PLACEHOLDER: quantitative criteria TBD (position accuracy, waypoint tracking, route-following tolerance).
Rationale: Derived from functional analysis: the Navigate function is required to fly the mission route but is not covered by the sizing-derived requirement set.
Keywords: draft, derived, placeholder, todo

### 1.4 [REQ_F16A_D04] Communication and identification
The aircraft shall exchange voice and data communications and identify friend or foe (IFF). PLACEHOLDER: quantitative criteria TBD (datalink availability, communication range, IFF interrogation/response).
Rationale: Derived from functional analysis: the Communicate function is required to operate in a networked battlespace but is not covered by the sizing-derived requirement set.
Keywords: draft, derived, placeholder, todo

### 1.5 [REQ_F16A_D05] Find targets
The aircraft shall detect potential targets within the combat area. PLACEHOLDER: quantitative criteria TBD (detection range, sensor field of regard).
Rationale: Derived from functional analysis: the Find step of the F2T2EA kill chain is required for combat but is not covered by the sizing-derived requirement set.
Keywords: draft, derived, placeholder, todo

### 1.6 [REQ_F16A_D06] Fix targets
The aircraft shall determine the location and identity of detected targets to a fix. PLACEHOLDER: quantitative criteria TBD (geolocation accuracy, identification confidence).
Rationale: Derived from functional analysis: the Fix step of the F2T2EA kill chain is required for combat but is not covered by the sizing-derived requirement set.
Keywords: draft, derived, placeholder, todo

### 1.7 [REQ_F16A_D07] Track targets
The aircraft shall maintain track on fixed targets. PLACEHOLDER: quantitative criteria TBD (number of simultaneous tracks, track continuity).
Rationale: Derived from functional analysis: the Track step of the F2T2EA kill chain is required for combat but is not covered by the sizing-derived requirement set.
Keywords: draft, derived, placeholder, todo

### 1.8 [REQ_F16A_D08] Target and assign weapons
The aircraft shall prioritize and designate targets and assign weapons. PLACEHOLDER: quantitative criteria TBD (targeting timeline, weapon-target pairing).
Rationale: Derived from functional analysis: the Target step of the F2T2EA kill chain is required for combat but is not covered by the sizing-derived requirement set.
Keywords: draft, derived, placeholder, todo

### 1.9 [REQ_F16A_D09] Assess engagement
The aircraft shall assess engagement results (battle damage assessment). PLACEHOLDER: quantitative criteria TBD (BDA reporting, re-attack decision support).
Rationale: Derived from functional analysis: the Assess step of the F2T2EA kill chain is required for combat but is not covered by the sizing-derived requirement set.
Keywords: draft, derived, placeholder, todo