# Requirement set f16a_physical_derived (R2026a)
Requirements owned and verified at the Physical layer (RFLP P) of the F-16A model. Kept separate from the sizing-derived set (f16a.slreqx), the functional-derived set, and the logical-derived set.

## 1 [REQ_F16A_PHYSICAL] F-16A physical-layer requirements (Container)
Root container for requirements surfaced and verified at the Physical layer, where concrete parts and roll-up analyses exist to measure them.
Keywords: draft, derived, physical

### 1.1 [REQ_F16A_P01] Fuel volume sufficiency
The aircraft shall provide sufficient internal fuel tankage (volume, expressed as fuel-weight capacity) to carry the fuel required to complete the design mission profile (REQ_F16A_001-010), without reliance on external tanks. Verification method: the total available fuel capacity (a roll-up over the internal fuel tanks) shall be greater than or equal to the mission fuel required (from mission analysis).
Rationale: Range/endurance closure depends on carrying enough fuel, and the check belongs at P because it needs concrete tanks to roll up an available capacity from. Both sides are now real numbers: the tanks roll up to 6300 lb and the mission analysis burns about 5960 lb, so the requirement is met with roughly 340 lb of margin (D-060).
Keywords: draft, derived, physical

### 1.2 [REQ_F16A_P02] Life-cycle cost
The aircraft's life-cycle cost -- unit flyaway cost plus operating and support cost over the service life -- shall be quantified for the design mission profile (REQ_F16A_001-010). Verification method: MeasureOfMerit.LifeCycleCost_USD on the aircraft, computed by F16APhysicalCostModel from this model's rolled-up empty weight and its mission fuel and sortie time. No cost ceiling is stated: no sourced affordability target exists for this example, and inventing one would be inventing a requirement.
Rationale: Mission fuel reaches cost through exactly one path -- the operating and support terms -- so life-cycle cost is the only Measure of Merit that moves when the mission changes; the unit flyaway does not (D-043, D-061). Without this requirement LifeCycleCost_USD would sit on the aircraft traced to nothing. Cross-check: BrandtCost's own life-cycle figure is about $93.26M.
Keywords: draft, derived, physical