% Requirement links of F16AFuelVerificationTest.m (R2026a)

% lines 47-63 verifies f16a_physical_derived.slreqx#2
        function testFuelSufficientForMission(testCase)
            % REQ_F16A_P01: available internal fuel shall be >= mission fuel.
            available = F16APhysicalFuelRollup().AvailableFuel_lb;
            required  = F16APhysicalMissionFuel();
            % The diagnostic names the STATE, not a repair. Telling a reader to
            % connect the mission analysis would instruct them to do the one
            % thing D-042 decided against, and would present an unevaluated
            % requirement as an outstanding chore.
            msg = sprintf("REQ_F16A_P01 UNEVALUATED -- this failure is EXPECTED and " + ...
                "PERMANENT (D-042): available=%.0f lb, required=%g. Nothing has been " + ...
                "compared: F16APhysicalMissionFuel returns NaN BY DESIGN, so this red " + ...
                "is not a violation and says nothing about the aircraft. Do NOT clear " + ...
                "it by wiring mission fuel to the /sizing/ analysis. Contrast the " + ...
                "landing red in F16AStaticMarginVerificationTest, where both sides are " + ...
                "finite numbers and the design genuinely fails.", available, required);
            testCase.verifyGreaterThanOrEqual(available, required, msg);
        end