% Requirement links of F16AMaterialsVerificationTest.m (R2026a)

% lines 23-31 verifies f16a.slreqx#28
        function testAirframeCompositeWithinLimit(testCase)
            % REQ_F16A_022: airframe composite fraction shall be <= 20%.
            mats = F16APhysicalMaterialsRollup();
            testCase.verifyGreaterThan(mats.CompositeFraction, 0, ...
                "Composite roll-up returned 0 -- CompositeFraction properties not set?");
            testCase.verifyLessThanOrEqual(mats.CompositeFraction, 0.20, ...
                sprintf("REQ_F16A_022 NOT met: airframe composite fraction %.1f%% exceeds the 20%% cap.", ...
                100*mats.CompositeFraction));
        end