% Requirement links of F16AStaticMarginVerificationTest.m (R2026b)

% lines 88-94 verifies f16a.slreqx#33
                "the wrong fields -- fix the reader, do not reinterpret the result.");
            % string(num2str(x)), NOT string(x) -- do not revert. string(NaN) is
            % <missing>, which the diagnostic framework rejects, so the obvious
            % spelling deletes this message on the input it exists for (08_agent_team).
            testCase.verifyTrue(isfinite(testCase.Balance.SM_TO), ...
                "Static margin at takeoff is not finite (" + ...
                string(num2str(testCase.Balance.SM_TO)) + "). This is a broken " + ...

% lines 94-105 verifies f16a.slreqx#33
                string(num2str(testCase.Balance.SM_TO)) + "). This is a broken " + ...
                "analysis, not a requirement violation.");
            testCase.verifyTrue(isfinite(testCase.Balance.SM_land), ...
                "Static margin at landing is not finite (" + ...
                string(num2str(testCase.Balance.SM_land)) + "). This is a broken " + ...
                "analysis, not a requirement violation.");
        end

        function testTakeoffStaticMarginIsNegative(testCase)
            % The AFT end of the CG range -- heaviest, full fuel, full stores --
            % and so the LEAST stable end. Stores and fuel sit aft of the CG, so
            % using them moves it forward. EXPECTED TO PASS.